# Dynamo graph CycloJSONmetingImporten_v001.dyn (Dynamo 2.5.2.7915)

# group: Selecteer een gedownloadde JSON vanuit Cyclomedia
file_path = Filename("..\..\..\Downloads\EPSG_28992_measurement_bundle_13-10-2021.json")  # graph input
readText = FileSystem.ReadText(file=file_path)
parseJSON = Data.ParseJSON(json=readText)

# group: Selecteer uit de JSON de dictionary coordinates in features/geometry
code_block = CodeBlock { "features"; }
valueAtKey = DesignScript.Builtin.Dictionary.ValueAtKey(dictionary=parseJSON, key=code_block)
code_block_2 = CodeBlock { "geometry"; }
valueAtKey_2 = DesignScript.Builtin.Dictionary.ValueAtKey(dictionary=valueAtKey, key=code_block_2)
code_block_3 = CodeBlock { "coordinates"; }
valueAtKey_3 = DesignScript.Builtin.Dictionary.ValueAtKey(dictionary=valueAtKey_2, key=code_block_3)

# group: Verwijder 1 list laag
firstItem = List.FirstItem(list=valueAtKey_3)

# group: Is het een 2d of 3d polyline?
code_block_4 = CodeBlock { 2; }
count = List.Count(list=firstItem@L2)
eq = code_block_4 == count
code_block_5 = CodeBlock { true; false; }
if_ = If(test=eq, true=code_block_5.out0, false=code_block_5.out1)
filterByBoolMask = List.FilterByBoolMask(list=firstItem, mask=if_)
code_block_6 = CodeBlock { 1; }
code_block_7 = CodeBlock { 0; }

# group: Het is een 2d lijn: splits uit naar x,y en 0.
removeItemAtIndex = List.RemoveItemAtIndex(list=filterByBoolMask.in@L2, indices=code_block_6)
removeItemAtIndex_2 = List.RemoveItemAtIndex(list=filterByBoolMask.in@L2, indices=code_block_7)
code_block_8 = CodeBlock { 0; }
byCoordinates = Point.ByCoordinates(x=removeItemAtIndex, y=removeItemAtIndex_2, z=code_block_8)
flatten = List.Flatten(list=byCoordinates)

# group: Het is een 3d lijn: splits de coordinaten uit naar x,y,z
removeItemAtIndex_3 = List.RemoveItemAtIndex(list=filterByBoolMask.out@L2, indices=code_block_6)
code_block_9 = CodeBlock { 1; }
removeItemAtIndex_4 = List.RemoveItemAtIndex(list=removeItemAtIndex_3@L2, indices=code_block_9)
removeItemAtIndex_5 = List.RemoveItemAtIndex(list=filterByBoolMask.out@L2, indices=code_block_7)
removeItemAtIndex_6 = List.RemoveItemAtIndex(list=removeItemAtIndex_5@L2, indices=code_block_9)
removeItemAtIndex_7 = List.RemoveItemAtIndex(list=filterByBoolMask.out@L2, indices=code_block_7)
code_block_10 = CodeBlock { 0; }
removeItemAtIndex_8 = List.RemoveItemAtIndex(list=removeItemAtIndex_7@L2, indices=code_block_10)
byCoordinates_2 = Point.ByCoordinates(x=removeItemAtIndex_4, y=removeItemAtIndex_6, z=removeItemAtIndex_8)
flatten_2 = List.Flatten(list=byCoordinates_2)

# group: Exporteer de 2d of 3d lijn van Dynamo naar ACAD
current = Autodesk.AutoCAD.DynamoNodes.Document.Current()
currentLayer = Autodesk.AutoCAD.DynamoNodes.Document.CurrentLayer(document=current)
modelSpace = Autodesk.AutoCAD.DynamoNodes.Document.ModelSpace(document=current)
byPoints = Autodesk.AutoCAD.DynamoNodes.Polyline.ByPoints(points=flatten, layer=currentLayer, block=modelSpace)
byPoints_2 = Autodesk.AutoCAD.DynamoNodes.Polyline3D.ByPoints(points=flatten_2, layer=currentLayer, block=modelSpace)
