# Dynamo graph Ronde_duiker_v007.dyn (Dynamo 2.5.2.7915)
# packages: LinkDWG 0.3.89

# group: INPUT
profielnaam = CodeBlock { "Spirosol SPM-21"; "Multiplate MA-6"; }
code_block = CodeBlock()
# ---------- code_block.designscript (2 lines) ----------
//dikte staal
0.1;
# ----------------------------------------

select_object = ObjectSelection()  # 1 picked in the model; graph input
geometry = Autodesk.AutoCAD.DynamoNodes.Object.Geometry(object=select_object)
string = StringInput("C:\Users\wthoen\OneDrive - Joh. Mourik & Co. Holding B.V\Mourik\InfraWorks\Bieb\modellen\Bergschenhoek CT bieb\dynamo\")
keuze_profiel_bijzonder = CodeBlock { a; }  # unwired: a
startPoint = Curve.StartPoint(curve=geometry)

# group: Locatie terug bepalen naar 0,0,0
endPoint = Curve.EndPoint(curve=geometry)
code_block_2 = CodeBlock { 0; }
X = Point.X(point=startPoint)
sub = code_block_2 - X
Y = Point.Y(point=startPoint)
sub_2 = code_block_2 - Y
translate = Geometry.Translate(geometry=geometry, xTranslation=sub, yTranslation=sub_2)
startPoint_2 = Curve.StartPoint(curve=translate)
endPoint_2 = Curve.EndPoint(curve=translate)

# group: Richting bepalen en coordinatesystem plaatsen
byTwoPoints = Vector.ByTwoPoints(start=endPoint_2, end=startPoint_2)
ZAxis = Vector.ZAxis()
byOriginVectors = CoordinateSystem.ByOriginVectors(origin=startPoint_2, xAxis=byTwoPoints, zAxis=ZAxis)
origin = CoordinateSystem.Origin(coordinateSystem=byOriginVectors)
X_2 = Point.X(point=origin)
Y_2 = Point.Y(point=origin)
Z = Point.Z(point=origin)

# group: Profiel inladen vanuit csv en op locatie zetten
string_2 = StringInput(".csv")
concat = String.Concat(string0=string, string1=keuze_profiel_bijzonder, string2=string_2)
importCSV = Data.ImportCSV(filePath=concat)
code_block_3 = CodeBlock { 2; 3; }
getItemAtIndex = List.GetItemAtIndex(list=importCSV, index=code_block_3.out0)
code_block_4 = CodeBlock { 1; }
dropItems = List.DropItems(list=getItemAtIndex, amount=code_block_4)
getItemAtIndex_2 = List.GetItemAtIndex(list=importCSV, index=code_block_3.out1)
dropItems_2 = List.DropItems(list=getItemAtIndex_2, amount=code_block_4)
byCoordinates = Point.ByCoordinates(x=dropItems, y=dropItems_2)
code_block_5 = CodeBlock { true; }
byPoints = PolyCurve.ByPoints(points=byCoordinates, connectLastToFirst=code_block_5)
translate_2 = Geometry.Translate(geometry=byPoints, xTranslation=X_2, yTranslation=Y_2, zTranslation=Z)

ZAxis_2 = Vector.ZAxis()
code_block_6 = CodeBlock { 19; }
getItemAtIndex_3 = List.GetItemAtIndex(list=byCoordinates, index=code_block_6)
YAxis = CoordinateSystem.YAxis(coordinateSystem=byOriginVectors)
code_block_7 = CodeBlock { -90; }
rotate = Geometry.Rotate(geometry=translate_2, origin=origin, axis=YAxis, degrees=code_block_7)
code_block_8 = CodeBlock { 0; }
sub_3 = code_block_8 - code_block
code_block_9 = CodeBlock { 2; }
div = sub_3 / code_block_9
translate_3 = Geometry.Translate(geometry=rotate, zTranslation=div)
closeWithLine = PolyCurve.CloseWithLine(polyCurve=translate_3)
code_block_10 = CodeBlock { 2; }
div_2 = code_block / code_block_10

# group: Profiel draaien en rechtop zetten
YAxis_2 = Vector.YAxis()
byTwoPoints_2 = Vector.ByTwoPoints(start=origin, end=getItemAtIndex_3)
angleWithVector = Vector.AngleWithVector(vector=YAxis_2, otherVector=byTwoPoints_2)
rotate_2 = Geometry.Rotate(geometry=translate_2, origin=origin, axis=ZAxis_2, degrees=angleWithVector)
YAxis_3 = CoordinateSystem.YAxis(coordinateSystem=byOriginVectors)
code_block_11 = CodeBlock { 90; }
rotate_3 = Geometry.Rotate(geometry=rotate_2, origin=origin, axis=YAxis_3, degrees=code_block_11)
code_block_12 = CodeBlock { 0; }
sub_4 = code_block_12 - div_2
code_block_13 = CodeBlock { true; }
offset = PolyCurve.Offset(polyCurve=closeWithLine, signedDistance=sub_4, extendCircular=code_block_13)

code_block_14 = CodeBlock { 2; }
mul = code_block_14 * div_2
offset_2 = Curve.Offset(curve=offset, distance=mul)
code_block_15 = CodeBlock { 0; }
code_block_16 = CodeBlock { 2; }
div_3 = code_block / code_block_16
sub_5 = code_block_15 - div_3
layername = StringInput("N-WE-KW-KUNSTWERK_DUIKER_GROOT")  # graph input
objectcode = StringInput("O.DW.1")  # graph input

# group: offsetten en subtracten en exproteren naar acad
bySweep = Solid.BySweep(profile=offset_2, path=translate)
bySweep_2 = Solid.BySweep(profile=offset, path=translate)
differenceAll = Solid.DifferenceAll(solid=bySweep, others=bySweep_2)
translate_4 = Geometry.Translate(geometry=differenceAll, xTranslation=X, yTranslation=Y, zTranslation=sub_5)
code_block_17 = CodeBlock { "-"; "-S"; }
concat_2 = String.Concat(string0=layername, string1=code_block_17.out0, string2=objectcode, string3=code_block_17.out1)
current = Autodesk.AutoCAD.DynamoNodes.Document.Current()
modelSpace = Autodesk.AutoCAD.DynamoNodes.Document.ModelSpace(document=current)
byGeometry = Autodesk.AutoCAD.DynamoNodes.Object.ByGeometry(geometry=translate_4, layer=concat_2, block=modelSpace)

code_block_18 = CodeBlock()
# ---------- code_block_18.designscript (15 lines) ----------
//Profielen toevoegen
// 1. Kopieer een profiel uit de bergschenhoek totaal tekening
// 2. Verschaal het profiel naar meters
// 3. leg de bob op 0,0,0
// 4. Haal de groene lijnen eruit
// 5. insert pi's met een increment van 0.25
// 6. break de lijn op bob
// 7. start cadtools en export de polyline coordinates to excel
// 8. save as csv
// 9. check of komma scheidingsteken is en coordinaten met punten zijn




// lijn tekenen van zuid naar noord?!
# ----------------------------------------
YZPlane = CoordinateSystem.YZPlane(coordinateSystem=byOriginVectors)
keuze_profiel_vierkant_profiel = CodeBlock { breedte; hoogte; Wanddikte; }  # unwired: breedte, hoogte, Wanddikte

# group: afmeting naar meters
code_block_19 = CodeBlock { 1000; 2; }
mm_omzetten_naar_meters = keuze_profiel_vierkant_profiel.breedte / code_block_19.out0

mm_omzetten_naar_meters_2 = keuze_profiel_vierkant_profiel.hoogte / code_block_19.out0
code_block_20 = CodeBlock { 2; }
div_4 = mm_omzetten_naar_meters_2 / code_block_20
wanddikte_vierkant_profiel_m = DoubleInput(0.1)
breedte_vierkant_profiel_mm = DoubleInput(300)
hoogte_vierkant_profiel_mm = DoubleInput(300)
diameter_ronde_buis_mm = DoubleInput(300)  # graph input
keuze_profiel_ronde_buis = CodeBlock(diameter=diameter_ronde_buis_mm) { diameter; }

# group: diameter naar straal en meters
code_block_21 = CodeBlock { 1000; 2; }
mm_omzetten_naar_meters_3 = keuze_profiel_ronde_buis / code_block_21.out0
diameter_naar_straal = mm_omzetten_naar_meters_3 / code_block_21.out1

wanddikte = CodeBlock(diameter=keuze_profiel_ronde_buis)
# ---------- wanddikte.designscript (5 lines) ----------
diameter;

//10% van de diameter en omrekenen naar meters
// ouput is diameter dus maal 2
diameter*0.1*0.001*2;
# ----------------------------------------

# group: Diameter incl wanddikte naar straal incl wanddikte
code_block_22 = CodeBlock { 2; }
div_5 = wanddikte.out1 / code_block_22
add = diameter_naar_straal + div_5

# group: Cirkel plaatsen op YZ as van coordinate system en op bob hoogte zetten
YZPlane_2 = CoordinateSystem.YZPlane(coordinateSystem=byOriginVectors)
byPlaneRadius = Circle.ByPlaneRadius(plane=YZPlane_2, radius=add)
hart_naar_bob_hoogte = Geometry.Translate(geometry=byPlaneRadius, zTranslation=diameter_naar_straal)
byPlaneRadius_2 = Circle.ByPlaneRadius(plane=YZPlane_2, radius=diameter_naar_straal)
hart_naar_bob_hoogte_2 = Geometry.Translate(geometry=byPlaneRadius_2, zTranslation=diameter_naar_straal)

byWidthLength = Rectangle.ByWidthLength(plane=YZPlane_2, width=mm_omzetten_naar_meters, length=mm_omzetten_naar_meters_2)
hart_naar_bob_hoogte_3 = Geometry.Translate(geometry=byWidthLength, zTranslation=div_4)
offset_3 = Curve.Offset(curve=hart_naar_bob_hoogte_3, distance=keuze_profiel_vierkant_profiel.Wanddikte)

# group: sweepen en exporteren naar acad
bySweep_3 = Solid.BySweep(profile=offset_3, path=translate)
bySweep_4 = Solid.BySweep(profile=hart_naar_bob_hoogte_3, path=translate)
differenceAll_2 = Solid.DifferenceAll(solid=bySweep_3, others=bySweep_4)
translate_5 = Geometry.Translate(geometry=differenceAll_2, xTranslation=X, yTranslation=Y)
byGeometry_2 = Autodesk.AutoCAD.DynamoNodes.Object.ByGeometry(geometry=translate_5, layer=concat_2, block=modelSpace)

# group: sweepen en exporteren naar acad
bySweep_5 = Solid.BySweep(profile=hart_naar_bob_hoogte, path=translate)
bySweep_6 = Solid.BySweep(profile=hart_naar_bob_hoogte_2, path=translate)
differenceAll_3 = Solid.DifferenceAll(solid=bySweep_5, others=bySweep_6)
translate_6 = Geometry.Translate(geometry=differenceAll_3, xTranslation=X, yTranslation=Y)
byGeometry_3 = Autodesk.AutoCAD.DynamoNodes.Object.ByGeometry(geometry=translate_6, layer=concat_2, block=modelSpace)

isNull = Object.IsNull(obj=byGeometry_3)
code_block_23 = CodeBlock { true; false; }
if_ = If(test=isNull, true=code_block_23.out1, false=code_block_23.out0)
code_block_24 = CodeBlock { "DYNAMO_PERSISTENT"; }
callNativeCommand = Custom[CallNativeCommand](Execute=if_, CommandName=code_block_24)  # package LinkDWG; Call AutoCAD native command
